# Grasshopper definition Chapter 01 Overview.gh (Grasshopper 1.0.7)
# plug-ins: Human

sharp = Panel("1")
round = Panel("2")
chamfer = Panel("4")
crv = Curve(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)
offset = OffsetCurve(Curve=crv, Distance=1, Plane=PlaneXY(0, 0, 0), Corners=[sharp, round, chamfer])
explode = Explode(Curve=flatten(offset), Recursive=True)  # -> Segments, Vertices
pt = Point(flatten(explode.Vertices))
panel = Panel("""4
5""")
item = ListItem(List=pt, Index=panel, Wrap=True)
crv_cp = CurveClosestPoint(Point=item, Curve=offset)  # -> Point, Parameter, Distance
shatter = Shatter(Curve=offset, Parameters=crv_cp.Parameter)
item_2 = ListItem(List=shatter, Index=Slider(1, range=0..2), Wrap=True)  # -> Item1, Item, Item1_2
previewlw = CustomPreviewLineweights(
    Geometry=flatten(item_2.Item),
    Shader=[ColourSwatch(SwatchColor=RGB(255, 0, 255)), ColourSwatch(SwatchColor=RGB(0, 0, 255)), ColourSwatch(SwatchColor=RGB(0, 255, 255))],
    Absolute=False)
previewlw_2 = CustomPreviewLineweights(Geometry=flatten([item_2.Item1, item_2.Item1_2]), Shader=ColourSwatch(SwatchColor=RGB(219, 219, 219)), Absolute=False)
