# Grasshopper definition Chapter 04 Intro to Exterior Calculus.gh (Grasshopper 1.0.7)

brep = Brep(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)
brep_2 = Brep(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)
debrep = DeconstructBrep(Brep=[brep_2, brep])  # -> Faces, Edges, Vertices
evalsrf = EvaluateSurface(Surface=reparameterize(debrep.Faces), Point="0.5,0.5")  # -> Point, Normal, UDirection, VDirection, Frame
area = Area(Geometry=debrep.Faces)  # -> Area, Centroid
preview = CustomPreview(Geometry=brep, Material=ColourSwatch(SwatchColor=RGBA(0, 255, 255, 50)))
preview_2 = CustomPreview(Geometry=brep_2, Material=ColourSwatch(SwatchColor=RGBA(255, 0, 255, 50)))
unit = UnitVector(Vector=evalsrf.Normal)
amp = Amplitude(Vector=unit, Amplitude="0.3")
bang = ExplodeTree(Data=amp)  # -> Branch0, Branch1
rev = Reverse(Vector=bang.Branch1)
entwine = Entwine(Branch00=bang.Branch0, Branch01=rev, FlattenInputs=True)
vdisex = VectorDisplayEx(Point=evalsrf.Point, Vector=entwine, Colour=RGB(0, 0, 0), Width=2)
