# Grasshopper definition Chapter 02 Combinatioral Surfaces.gh (Grasshopper 1.0.7)
# plug-ins: Pufferfish, Human

crv = Curve([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])
end = EndPoints(Curve=crv)  # -> Start, End
shatter = Shatter(Curve=reparameterize(graft(crv)), Parameters=["0.1", "0.9"])
pt = Point([end.End, end.Start])
cullpt = CullDuplicates(Points=pt, Tolerance=0.1, CullMode=3)  # -> Points, Indices, Valence
item = ListItem(List=shatter, Index=Slider(1, range=0..10), Wrap=True)  # -> flatten(Item)
item_2 = ListItem(List=cullpt.Points, Index=Slider(2, range=0..10), Wrap=True)  # -> flatten(Item)
offcrv = OffsetCurve(Curve=item, Distance="0.1", Plane=PlaneXY(0, 0, 0), BothSides=Toggle(True), Kinks=0, CapType="0")
item_3 = ListItem(List=crv, Index=0, Wrap=True)  # -> Item, Item1, Item2, Item3, Item4
crv_2 = Curve(offcrv)
swatch = ColourSwatch(SwatchColor=RGB(0, 0, 0))
crv_3 = Curve(item_3.Item4)
edgesrf = EdgeSurface(CurveA=item_3.Item, CurveB=item_3.Item1, CurveC=item_3.Item3)
edgesrf_2 = EdgeSurface(CurveA=item_3.Item2, CurveB=item_3.Item3, CurveC=item_3.Item4)
previewlw = CustomPreviewLineweights(Geometry=flatten(crv_2), Shader=ColourSwatch(SwatchColor=RGB(140, 140, 140)), Thickness="3", Absolute=False)
previewlw_2 = CustomPreviewLineweights(Geometry=crv, Shader=swatch, Thickness="3", Absolute=False)
# orbits of faces
preview = CustomPreview(Geometry=cullpt.Points, Material=swatch)
crv_4 = Curve(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)  # disabled

timer = Timer(TimerInterval=1000, Target=panel)  # disabled
panel = Panel("x")
rec = DataRecorder(panel, DataLimit=-10, RecordData=True)
lng = ListLength(List=rec)
panel_2 = Panel(lng)

crv_5 = Curve([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])  # disabled
item_4 = ListItem(List=crv_5, Index=0, Wrap=True)  # -> Item, Item1, Item2; disabled
# orbits of vertices
swatch_2 = ColourSwatch(SwatchColor=RGB(0, 255, 255))  # disabled
swatch_3 = ColourSwatch(SwatchColor=RGB(255, 0, 255))  # disabled
swatch_4 = ColourSwatch(SwatchColor=RGBA(0, 255, 255, 52))  # disabled
panel_3 = Panel("3")  # disabled
area = Area(Geometry=edgesrf)  # -> Area, Centroid; disabled
symsim = SymbolSimple(Style=4, Size=12, Rotation=0, Colour=swatch_2)  # disabled
mod = Modulus(A=panel_2, B=panel_3)  # disabled
symbol = SymbolDisplay(Location=area.Centroid, Display=symsim)  # disabled
preview_2 = CustomPreview(Geometry=edgesrf, Material=swatch_4)  # disabled
panel_4 = Panel(mod)  # disabled
filter = StreamFilter(Gate=panel_4, Stream0=item_4.Item, Stream1=item_4.Item1, Stream2=item_4.Item2)  # disabled
previewlw_3 = CustomPreviewLineweights(Geometry=flatten(filter), Shader=swatch_3, Thickness="3", Absolute=False)  # disabled

swatch_5 = ColourSwatch(SwatchColor=RGB(255, 0, 255))  # disabled
swatch_6 = ColourSwatch(SwatchColor=RGB(0, 255, 255))  # disabled
# orbits of edges
panel_5 = Panel("2")  # disabled
crv_6 = Curve(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)  # disabled
crv_7 = Curve(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)  # disabled
crv_8 = Curve(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)  # disabled
mod_2 = Modulus(A=panel_2, B=panel_5)  # disabled
panel_6 = Panel(mod_2)  # disabled
filter_2 = StreamFilter(Gate=panel_6, Stream0=crv_6, Stream1=crv_7)  # disabled
previewlw_4 = CustomPreviewLineweights(Geometry=flatten(filter_2), Shader=swatch_5, Thickness="3", Absolute=False)  # disabled
previewlw_5 = CustomPreviewLineweights(Geometry=flatten(crv_8), Shader=swatch_6, Thickness="3", Absolute=False)  # disabled

swatch_7 = ColourSwatch(SwatchColor=RGB(0, 0, 255))  # disabled
swatch_8 = ColourSwatch(SwatchColor=RGB(255, 0, 255))  # disabled
pt_2 = Point(item_2)  # disabled
crv_9 = Curve(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)  # disabled
crv_10 = Curve(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)  # disabled
crv_11 = Curve(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)  # disabled
swatch_9 = ColourSwatch(SwatchColor=RGB(0, 255, 255))  # disabled
panel_7 = Panel("4")  # disabled
preview_3 = CustomPreview(Geometry=pt_2, Material=swatch_9)  # disabled
mod_3 = Modulus(A=panel_2, B=panel_7)  # disabled
panel_8 = Panel(mod_3)  # disabled
filter_3 = StreamFilter(Gate=panel_8, Stream0=swatch_7, Stream1=swatch_8, Stream2=swatch_8, Stream3=swatch_7)  # disabled
filter_4 = StreamFilter(Gate=panel_8, Stream0=crv_11, Stream1=crv_10, Stream2=crv_9, Stream3=crv_4)  # disabled
previewlw_6 = CustomPreviewLineweights(Geometry=flatten(filter_4), Shader=filter_3, Thickness="3", Absolute=False)  # disabled

vdisex = VectorDisplayEx(Colour=RGB(0, 0, 0), Width=2)  # disabled
