# Grasshopper definition Chapter 03 Intro to Differential Geometry.gh (Grasshopper 1.0.7)
# plug-ins: Human, Colibri

parameter = Slider(1, range=0..1)  # disabled
crv = Curve(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)  # disabled
# 3.3.1 Normal Vector, Tangent Vector, Binormal Vector
crv_2 = Curve(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)  # disabled
iterator = ColibriIterator(Parameter=parameter, RemoteFly=False, ignoreAllWarningMsg=False)  # -> Parameter, Value_N, IterationGenome; disabled
pt = Point(Point(10, 0, 0))  # disabled
factor = Slider(-6.7, range=-50..0)  # disabled
frame = CurveFrame(Curve=reparameterize(crv_2), Parameter=iterator.Parameter)  # disabled
deplane = DeconstructPlane(Plane=frame)  # -> Origin, XAxis, YAxis, ZAxis; disabled
deplane_2 = DeconstructPlane(Plane=frame)  # -> Origin, XAxis, YAxis, ZAxis; disabled
xprod = CrossProduct(VectorA=deplane.XAxis, VectorB=deplane_2.YAxis, Unitize=False)  # -> Vector, Length; disabled
eval = EvaluateCurve(Curve=reparameterize(crv_2), Parameter=parameter)  # -> Point, Tangent, Angle; disabled
swatch = ColourSwatch(SwatchColor=RGB(0, 0, 0))  # disabled
# 3.3.2 What is curvature
pt_2 = Point(Point(-10, 0, 0))  # disabled
pt_3 = Point(Point(0, 0, 0))  # disabled

# ---- group: Normal Vector
vec = Vector(deplane_2.YAxis)  # disabled

# ---- group: Tangent Vector
vec_2 = Vector(deplane.XAxis)  # disabled

# ---- group: Binormal
vec_3 = Vector(xprod.Vector)  # disabled

# ----
iterator_2 = ColibriIterator(Factor=factor, RemoteFly=False, ignoreAllWarningMsg=False)  # -> Factor, Value_N, IterationGenome; disabled
Y = UnitY(Factor=expr("-x", factor))  # disabled
panel = Panel("9")  # disabled
preview = CustomPreview(Geometry=[frame, deplane.Origin], Material=swatch)  # disabled
move = Move(Geometry=pt, Motion=Y)  # -> Geometry, Transform; disabled
move_2 = Move(Geometry=pt_2, Motion=Y)  # -> Geometry, Transform; disabled
swatch_2 = ColourSwatch(SwatchColor=RGB(0, 255, 232))  # disabled
swatch_3 = ColourSwatch(SwatchColor=RGB(0, 0, 232))  # disabled
swatch_4 = ColourSwatch(SwatchColor=RGB(255, 0, 232))  # disabled
swatch_5 = ColourSwatch(SwatchColor=RGB(255, 0, 232))  # disabled
swatch_6 = ColourSwatch(SwatchColor=RGB(167, 169, 232))  # disabled
md_slider = MDSlider(
    SliderMode=0,
    slider_value=Point(0.4000001795, 0.08559570312, 0.5),
    x_domain=Domain(0, 1),
    y_domain=Domain(0, 1),
    z_domain=Domain(0, 1))  # disabled
srf = Surface(reparameterize(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))  # disabled
divide = DivideDomain²(Domain=srf, UCount=panel, VCount=panel)  # disabled
panel_2 = Panel("gh的k1和k2相反了")  # disabled
panel_3 = Panel("5")  # disabled
swatch_7 = ColourSwatch(SwatchColor=RGBA(167, 169, 232, 151))  # disabled
cdiv = Derivatives()  # -> Point, FirstDerivative; disabled
# 3.4.1
brep = Brep(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)
renameplz = Slider(0, range=0..1)  # disabled
md_slider_2 = MDSlider(SliderMode=0, slider_value=Point(0.5, 0.5, 0.5), x_domain=Domain(0, 1), y_domain=Domain(0, 1), z_domain=Domain(0, 1))
subsrf = Isotrim(Surface=reparameterize(srf), Domain=divide)  # disabled
nurbs = NurbsCurve(Vertices=[move_2.Geometry, pt_3, move.Geometry], Degree=2, Periodic=False)  # -> Curve, Length, Domain; disabled
preview_2 = CustomPreview(Geometry=srf, Material=swatch_7)  # disabled
vdisex = VectorDisplayEx(Point=deplane_2.Origin, Vector=vec_2, Colour=swatch_4, Width=2)  # disabled
vdisex_2 = VectorDisplayEx(Point=deplane_2.Origin, Vector=eval.Tangent, Colour=swatch_5, Width=2)  # disabled
vdisex_3 = VectorDisplayEx(Point=deplane_2.Origin, Vector=vec, Colour=swatch_3, Width=2)  # disabled
vdisex_4 = VectorDisplayEx(Point=deplane_2.Origin, Vector=vec_3, Colour=swatch_2, Width=2)  # disabled
evalsrf = EvaluateSurface(Surface=reparameterize(srf), Point=md_slider)  # -> Point, Normal, UDirection, VDirection, Frame; disabled
curvature = PrincipalCurvature(Surface=reparameterize(srf), Point=md_slider)  # -> Frame, Min, Max, MinDirection, MaxDirection; disabled
swatch_8 = ColourSwatch(SwatchColor=RGB(255, 0, 232))  # disabled
panel_4 = Panel("3")  # disabled
preview_3 = CustomPreview(Geometry=brep, Material=ColourSwatch(SwatchColor=RGBA(167, 169, 232, 128)))  # disabled
previewlw = CustomPreviewLineweights(Geometry=crv_2, Shader=swatch_6, Thickness=panel_3, Absolute=False)  # disabled
xy = XYPlane(Origin=Point(0, 0, 0))  # disabled
wires = BrepWireframe(Brep=subsrf, Density=-1)  # -> flatten(Wireframe); disabled
crvgraph = CurvatureGraph(Curve=crv_2, Density=5, Scale=105)  # disabled
curvature_2 = Curvature(Curve=reparameterize(crv_2), Parameter=parameter)  # -> P, K, C; disabled
swatch_9 = ColourSwatch(SwatchColor=RGB(0, 0, 0))  # disabled
panel_5 = Panel("0.5")  # disabled
osc = OsculatingCircles(Surface=reparameterize(brep), Point=md_slider_2)  # -> Point, FirstCircle, SecondCircle
panel_6 = Panel("1")  # disabled
amp = Amplitude(Vector=curvature.MaxDirection, Amplitude=panel_4)
eval_2 = EvaluateCurve(Curve=reparameterize(nurbs.Curve), Parameter=panel_5)  # -> Point, Tangent, Angle; disabled
pl_origin = PlaneOrigin(Base=xy, Origin=eval_2.Point)  # disabled
evalsrf_2 = EvaluateSurface()  # -> Point, Normal, UDirection, VDirection, Frame; disabled
orient = Orient(Geometry=nurbs.Curve, Source=pl_origin, Target=xy)  # -> Geometry, Transform; disabled
crv_3 = Curve(orient.Geometry)  # disabled
curvature_3 = Curvature(Curve=reparameterize(crv_3), Parameter=panel_5)  # -> P, K, C; disabled
previewlw_2 = CustomPreviewLineweights(Geometry=wires, Shader=swatch_9, Thickness=panel_6, Absolute=False)
crv_4 = Curve(osc.FirstCircle)  # disabled
crv_5 = Curve(osc.SecondCircle)  # disabled
move_3 = Move(Geometry=evalsrf.Point, Motion=expr("x*1.2", amp))  # -> Geometry, Transform; disabled
pt_4 = Point(evalsrf.Point)  # disabled
end = EndPoints(Curve=orient.Geometry)  # -> Start, End; disabled
panel_7 = Panel("3")  # disabled

# ---- group: k1
amp_2 = Amplitude(Vector=curvature.MinDirection, Amplitude=panel_4)
vdisex_5 = VectorDisplayEx(Point=evalsrf.Point, Vector=amp_2, Colour=swatch_8, Width=panel_4)

# ----
move_4 = Move(Geometry=evalsrf.Point, Motion=expr("x*1.2", amp_2))  # -> Geometry, Transform; disabled
crv_cp = CurveClosestPoint(Point=osc.Point, Curve=crv_4)  # -> Point, Parameter, Distance; disabled
crv_6 = Curve(curvature_3.C)  # disabled
area = Area(Geometry=crv_6)  # -> Area, Centroid; disabled
crv_cp_2 = CurveClosestPoint(Point=osc.Point, Curve=crv_5)  # -> Point, Parameter, Distance; disabled
pt_5 = Point(curvature_3.P)  # disabled
swatch_10 = ColourSwatch(SwatchColor=RGB(0, 0, 232))  # disabled
concat = Concatenate(FragmentA="k1=", FragmentB=curvature.Min)
concat_2 = Concatenate(FragmentA="k2=", FragmentB=curvature.Max)
curvature_4 = Curvature(Curve=crv_4, Parameter=crv_cp.Parameter)  # -> P, K, C; disabled
swatch_11 = ColourSwatch(SwatchColor=RGB(0, 255, 232))  # disabled
xprod_2 = CrossProduct(VectorA=curvature.MinDirection, VectorB=curvature.MaxDirection, Unitize=False)  # -> Vector, Length; disabled
swatch_12 = ColourSwatch(SwatchColor=RGB(0, 0, 232))  # disabled
swatch_13 = ColourSwatch(SwatchColor=RGB(255, 0, 232))  # disabled
curvature_5 = Curvature(Curve=crv_5, Parameter=crv_cp_2.Parameter)  # -> P, K, C; disabled
eval_3 = EvaluateCurve(Curve=crv_5, Parameter=crv_cp_2.Parameter)  # -> Point, Tangent, Angle; disabled
swatch_14 = ColourSwatch(SwatchColor=RGB(167, 169, 232))  # disabled
preview_4 = CustomPreview(Geometry=[end.Start, end.End, area.Centroid, pt_5], Material=swatch_11)  # disabled
panel_8 = Panel("3")  # disabled
eval_4 = EvaluateCurve(Curve=crv_4, Parameter=crv_cp.Parameter)  # -> Point, Tangent, Angle; disabled
panel_9 = Panel("40")  # disabled
swatch_15 = ColourSwatch(SwatchColor=RGB(255, 0, 232))  # disabled
swatch_16 = ColourSwatch(SwatchColor=RGB(0, 0, 232))  # disabled
vlen = VectorLength(Vector=curvature_4.K)  # disabled
vdisex_6 = VectorDisplayEx(Point=evalsrf.Point, Vector=amp, Colour=swatch_10, Width=panel_4)  # disabled
ln = Line(StartPoint=pt_5, EndPoint=area.Centroid)  # disabled
panel_10 = Panel(concat)
tag = TextTag(Location=move_4.Geometry, Text=panel_10)  # disabled
panel_11 = Panel(concat_2)
tag_2 = TextTag(Location=move_3.Geometry, Text=panel_11)  # disabled
range = Range(Domain=Domain(0, 1), Steps=panel_9)  # disabled
vlen_2 = VectorLength(Vector=curvature_5.K)  # disabled
osc_2 = OsculatingCircles()  # -> Point, FirstCircle, SecondCircle
panel_12 = Panel("5")  # disabled
vdisex_7 = VectorDisplayEx(Point=eval_4.Point, Vector=eval_4.Tangent, Colour=swatch_16, Width=panel_12)  # disabled
panel_13 = Panel(vlen)  # disabled
pl = ConstructPlane(Origin=evalsrf.Point, XAxis=amp_2, YAxis=amp)  # disabled
expression = Expression(Expression="Format(\"{0}, {1}\", x, y)")  # disabled
vdisex_8 = VectorDisplayEx(Point=eval_3.Point, Vector=eval_3.Tangent, Colour=swatch_15, Width=panel_12)  # disabled
panel_14 = Panel(vlen_2)  # disabled
shatter = Shatter(Curve=reparameterize(ln), Parameters=range)  # disabled
panel_15 = Panel("30")  # disabled
previewlw_3 = CustomPreviewLineweights(Geometry=crv_3, Shader=swatch_13, Thickness=panel_7, Absolute=False)  # disabled
curvepoint = PointOnCurve(ln, parameter=0.5)  # disabled
previewlw_4 = CustomPreviewLineweights(Geometry=crv_6, Shader=swatch_14, Thickness=panel_7, Absolute=False)  # disabled
previewlw_5 = CustomPreviewLineweights(Geometry=crv_3, Shader=swatch_14, Thickness=panel_7, Absolute=False)  # disabled
panel_16 = Panel("-3")  # disabled
swatch_17 = ColourSwatch(SwatchColor=RGB(0, 255, 232))  # disabled
panel_17 = Panel("k")  # disabled
rad = Radians(Degrees=panel_15)  # disabled
swatch_18 = ColourSwatch(SwatchColor=RGB(0, 255, 232))  # disabled
previewlw_6 = CustomPreviewLineweights(Geometry=[crv_4, crv_5], Shader=swatch_18, Thickness=panel_8, Absolute=False)  # disabled
X = UnitX(Factor=panel_16)  # disabled
cull = CullPattern(List=shatter, CullPattern=[False, False, True, True])  # disabled
previewlw_7 = CustomPreviewLineweights(Geometry=cull, Shader=swatch_12, Thickness=panel_7, Absolute=False)  # disabled
unit = UnitVector()  # disabled
aligndim = AlignedDimension(Plane=PlaneXY(0, 0, 0), PointA=pt_5, PointB=area.Centroid, Offset=1, Text="{0:0.00}", Size=0.5)  # disabled
panel_18 = Panel("k_2=0")  # disabled
move_5 = Move(Geometry=evalsrf.Point, Motion=amp_2)  # -> Geometry, Transform; disabled
move_6 = Move(Geometry=curvepoint, Motion=X)  # -> Geometry, Transform; disabled
vrot = Rotate(Vector=amp_2, Axis=xprod_2.Vector, Angle=rad)  # disabled
move_7 = Move(Geometry=evalsrf.Point, Motion=vrot)  # -> Geometry, Transform; disabled
move_8 = Move(Geometry=eval_3.Point, Motion=expr("x+{0,0,0.2}", eval_3.Tangent))  # -> Geometry, Transform; disabled
panel_19 = Panel("k=1/r")  # disabled
tag_3 = TextTag(Location=move_6.Geometry, Text=panel_19)  # disabled
swatch_19 = ColourSwatch(SwatchColor=RGB(0, 0, 0))  # disabled
tag_4 = TextTag(Location=move_8.Geometry, Text=panel_18, Colour=swatch_19)  # disabled
panel_20 = Panel("k_1=1")  # disabled
angledim = AngularDimension(Center=evalsrf.Point, PointA=move_5.Geometry, PointB=move_7.Geometry, Reflex=False, Text="{0:0.0}°", Size=0.2)  # disabled
vdisex_9 = VectorDisplayEx(Point=evalsrf.Point, Vector=vrot, Colour=swatch_17, Width=panel_4)  # disabled
move_9 = Move(Geometry=eval_4.Point, Motion=expr("x+{0,0,0.2}", eval_4.Tangent))  # -> Geometry, Transform; disabled
tag_5 = TextTag(Location=move_9.Geometry, Text=panel_20, Colour=swatch_19)  # disabled
md_slider_3 = MDSlider(SliderMode=0, slider_value=Point(0.5, 0.5, 0.5), x_domain=Domain(0, 1), y_domain=Domain(0, 1), z_domain=Domain(0, 1))  # disabled
# 3.4.1 Different point of curvature
srf_2 = Surface([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])  # disabled
srf_3 = Surface([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])
item = ListItem(List=srf_2, Index=0, Wrap=True)  # -> Item, Item1, Item2, Item3; disabled
item_2 = ListItem(List=srf_3, Index=0, Wrap=True)  # -> Item, Item1, Item2, Item3
md_slider_4 = MDSlider(
    SliderMode=0,
    slider_value=Point(0.6551246643, 0.2901573181, 0.5),
    x_domain=Domain(0, 1),
    y_domain=Domain(0, 1),
    z_domain=Domain(0, 1))
srf_4 = Surface(item_2.Item2)
iso = IsoCurve(Surface=reparameterize(item.Item3), UVPoint=md_slider_3)  # -> UIsocurve, VIsocurve; disabled
evalsrf_3 = EvaluateSurface(Surface=reparameterize(item.Item3), Point=md_slider_3)  # -> Point, Normal, UDirection, VDirection, Frame; disabled
curvature_6 = PrincipalCurvature(Surface=reparameterize(srf_4), Point=md_slider_4)  # -> Frame, Min, Max, expr("x*2", MinDirection), expr("x*2", MaxDirection)
evalsrf_4 = EvaluateSurface(Surface=reparameterize(srf_4), Point=md_slider_4)  # -> Point, Normal, UDirection, VDirection, Frame
swatch_20 = ColourSwatch(SwatchColor=RGB(0, 0, 0))  # disabled
xprod_3 = CrossProduct(VectorA=curvature_6.MinDirection, VectorB=curvature_6.MaxDirection, Unitize=False)  # -> Vector, Length
panel_21 = Panel("3")  # disabled
swatch_21 = ColourSwatch(SwatchColor=RGB(113, 33, 33))  # disabled
swatch_22 = ColourSwatch(SwatchColor=RGB(255, 0, 255))  # disabled
previewlw_8 = CustomPreviewLineweights(Geometry=[iso.UIsocurve, iso.VIsocurve], Shader=swatch_20, Thickness=panel_21, Absolute=False)  # disabled
panel_22 = Panel(curvature_6.Max)
panel_23 = Panel(curvature_6.Min)
swatch_23 = ColourSwatch(SwatchColor=RGB(0, 0, 0))
preview_5 = CustomPreview(Geometry=evalsrf_3.Frame, Material=swatch_21)  # disabled
swatch_24 = ColourSwatch(SwatchColor=RGB(0, 255, 255))  # disabled
preview_6 = CustomPreview(Geometry=srf_4, Material=ColourSwatch(SwatchColor=RGBA(167, 169, 232, 206)))
rad_2 = Radians(Degrees=expr("-x", "30"))
vdisex_10 = VectorDisplayEx(Point=evalsrf_3.Point, Vector=evalsrf_3.UDirection, Colour=swatch_22, Width=5)  # disabled
vdisex_11 = VectorDisplayEx(Point=evalsrf_3.Point, Vector=evalsrf_3.VDirection, Colour=swatch_24, Width=5)  # disabled
move_10 = Move(Geometry=evalsrf_4.Point, Motion=expr("x*1.2", curvature_6.MaxDirection))  # -> Geometry, Transform
move_11 = Move(Geometry=evalsrf_4.Point, Motion=expr("x*1.2", curvature_6.MinDirection))  # -> Geometry, Transform
vrot_2 = Rotate(Vector=curvature_6.MaxDirection, Axis=xprod_3.Vector, Angle=rad_2)
rev = Reverse(Vector=vrot_2)
move_12 = Move(Geometry=evalsrf_4.Point, Motion=expr("x*1.2", vrot_2))  # -> Geometry, Transform
move_13 = Move(Geometry=evalsrf_4.Point, Motion=expr("x*1.2", rev))  # -> Geometry, Transform
move_14 = Move(Geometry=evalsrf_4.Point, Motion=expr("x*1.2", vrot_2))  # -> Geometry, Transform
preview_7 = CustomPreview(Geometry=evalsrf_4.Frame, Material=swatch_23)
merge = Merge(Data1=move_12.Geometry, Data2=evalsrf_4.Point, Data3=move_13.Geometry)
concat_3 = Concatenate(FragmentA="k2 = ", FragmentB=curvature_6.Min)
concat_4 = Concatenate(FragmentA="k1 = ", FragmentB=curvature_6.Max)
vdisex_12 = VectorDisplayEx(Point=evalsrf_4.Point, Vector=vrot_2, Colour=ColourSwatch(SwatchColor=RGB(0, 0, 255)), Width=5)
xprod_4 = CrossProduct(VectorA=curvature_6.MinDirection, VectorB=curvature_6.MaxDirection, Unitize=False)  # -> Vector, Length
cos = Cosine(Value="30")
angledim_2 = AngularDimension(Center=evalsrf_4.Point, PointA=move_10.Geometry, PointB=move_14.Geometry, Reflex=False, Text="{0:0.0}°", Size=0.15)
sin = Sine(Value="30")
panel_24 = Panel(concat_3)
panel_25 = Panel(concat_4)
intcrv = Interpolate(Vertices=merge, Degree=3, Periodic=False, KnotStyle=1)  # -> Curve, Length, Domain
rev_2 = Reverse(Vector=xprod_4.Vector)
sqr = Square(Value=cos)
sqr_2 = Square(Value=sin)
project = Project(Curve=intcrv.Curve, Brep=srf_4, Direction=rev_2)
multiplication = Multiplication(A=curvature_6.Max, B=sqr)
panel_26 = Panel("0.5")
multiplication_2 = Multiplication(A=curvature_6.Min, B=sqr_2)
vdisex_13 = VectorDisplayEx(Point=evalsrf_4.Point, Vector=curvature_6.MinDirection, Colour=ColourSwatch(SwatchColor=RGB(255, 0, 255)), Width=5)
tag_6 = TextTag(Location=move_11.Geometry, Text=panel_24, Colour=swatch_23)
tag_7 = TextTag(Location=move_10.Geometry, Text=panel_25, Colour=swatch_23)
vdisex_14 = VectorDisplayEx(Point=evalsrf_4.Point, Vector=curvature_6.MaxDirection, Colour=ColourSwatch(SwatchColor=RGB(0, 255, 255)), Width=5)
crv_cp_3 = CurveClosestPoint(Point=evalsrf_4.Point, Curve=project)  # -> Point, Parameter, Distance
curvature_7 = Curvature(Curve=project, Parameter=crv_cp_3.Parameter)  # -> P, K, C
addition = Addition(A=multiplication, B=multiplication_2)
area_2 = Area(Geometry=curvature_7.C)  # -> Area, Centroid
panel_27 = Panel(addition)
dist = Distance(PointA=crv_cp_3.Point, PointB=area_2.Centroid)
curvature_8 = SurfaceCurvature()  # -> Frame, Gaussian, Mean
division = Division(A1=1, B=dist)
panel_28 = Panel(division)
