# Grasshopper definition Chapter 04 Intro to Exterior Calculus.gh (Grasshopper 1.0.7)

brep = Brep(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)
brep_2 = Brep(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)
debrep = DeconstructBrep(Brep=[brep_2, brep])  # -> Faces, Edges, Vertices
# Orientation of 3-vectors
panel = Panel("0.5,0.5")
evalsrf = EvaluateSurface(Surface=reparameterize(debrep.Faces), Point=panel)  # -> Point, Normal, UDirection, VDirection, Frame
area = Area(Geometry=debrep.Faces)  # -> Area, Centroid
preview = CustomPreview(Geometry=brep, Material=ColourSwatch(SwatchColor=RGBA(0, 255, 255, 50)))
preview_2 = CustomPreview(Geometry=brep_2, Material=ColourSwatch(SwatchColor=RGBA(255, 0, 255, 50)))
unit = UnitVector(Vector=evalsrf.Normal)
amp = Amplitude(Vector=unit, Amplitude="0.3")
bang = ExplodeTree(Data=amp)  # -> Branch0, Branch1
rev = Reverse(Vector=bang.Branch1)
entwine = Entwine(Branch00=bang.Branch0, Branch01=rev, FlattenInputs=True)
vdisex = VectorDisplayEx(Point=evalsrf.Point, Vector=entwine, Colour=RGB(0, 0, 0), Width=2)
vec = Vector(Vector(0, 0, 10))
vec_2 = Vector(Vector(0, 10, 0))
vec_3 = Vector(Vector(10, 0, 0))
mesh = Mesh(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)
# Right hand rules of Hodge Star
panel_2 = Panel("{0,0,0}")
pt = Point([Point(10.79608033, 0, 0), Point(0, 11.54750669, 0), Point(0, 0, 10.73236157)])
tag = TextTag(Location=pt, Text=["e1", "e2", "e3"], Colour=RGB(0, 0, 0))
preview_3 = CustomPreview(Geometry=mesh, Material=ColourSwatch(SwatchColor=RGBA(130, 130, 130, 111)))
vdisex_2 = VectorDisplayEx(
    Point=panel_2,
    Vector=[vec_3, vec_2, vec],
    Colour=[ColourSwatch(SwatchColor=RGB(0, 255, 255)), ColourSwatch(SwatchColor=RGB(255, 0, 255)), ColourSwatch(SwatchColor=RGB(0, 0, 255))],
    Width="5")
